# Grasshopper definition demonstrator.gh (Grasshopper 1.0.8)

# ---- group: Set Global Vars
panel = Panel("""a
b
c
d
e""")
panel_2 = Panel("""A
1
2.5
True
name""")
# try cast to int
# try cast to float
# try cast to bool
# try cast to string
py3 = GlobalVarSetter(keys=panel, values=panel_2)  # -> out, global_vars, types
# ---------- py3: Python ----------
"""
Script to 'set' global variables within grasshopper doc. Updates 'get' components upon changes.
    Inputs:
        keys: a list of keys for the global variables
        values: a list of values associated to the keys
    Output:
        global_vars: 'key:value' pairs
        types: 'type(key):type(value)
"""

import scriptcontext as rs
import Grasshopper

# Set the component name to something identifiable, to be controlled from other components.
component_name = 'Global Var Setter'
if ghenv.Component.Name != component_name:
    ghenv.Component.Name = component_name

# Add key:value pairs to the current grasshopper script context. 
rs.sticky[keys] = values

global_vars = f'{keys}:' + f'{rs.sticky[keys]}'
types = f'{type(keys)}:' + f'{type(rs.sticky[keys])}'

# Expire all 'getter' components within the current document to ensure they are 'getting' the latest global variables.
ghdoc = ghenv.Component.OnPingDocument()

for obj in ghdoc.Objects:
    if obj.Name == 'Global Var Getter':
        obj.ExpireSolution(True)
# ---------- end py3 ----------
panel_3 = Panel(py3.global_vars)

# ---- group: Clear Dictionary (for testing only)
clear = Python3Script(t=Button())
# ---------- clear: Python ----------
import scriptcontext as rs

print(rs.sticky)

if t:
    keys = []
    for key in rs.sticky:
        keys.append(key)

    for k in keys:
        rs.sticky.pop(k)
# ---------- end clear ----------

# ---- group: Get Global Vars
panel_4 = Panel("""a
B
c
d
e""")
py3_2 = GlobalVarGetter(key=panel_4)  # -> out, value, value_type
# ---------- py3_2: Python ----------
"""
Script to 'get' the value of a global variables within grasshopper doc.
    Inputs:
        key: the key of the global variable to get 
    Output:
        value: the value associated with the key
        value_type: the type of the value
"""

import scriptcontext as rs
import Grasshopper

# Set the component name to something identifiable, to be controlled from the setter component.
component_name = 'Global Var Getter'
if ghenv.Component.Name != component_name:
    ghenv.Component.Name = component_name

# Get the value of the provided key
try:
    value = rs.sticky[key]
except Exception as e:
    print('A value associated with the provided key could not be found.')

try:
    value_type = type(value)
except Exception as e:
    print('The type of the value could not be determined.')
# ---------- end py3_2 ----------
panel_5 = Panel(py3_2.out)
panel_6 = Panel(py3_2.value)
panel_7 = Panel(py3_2.value_type)
